# Grasshopper definition test.gh (Grasshopper 1.0.7)
# plug-ins: UrbanX_GH

pt = Point([<point referenced from the Rhino model> x102])
brep = Brep([<brep referenced from the Rhino model> x188])
u_sustain_er = Urban_Sustainability_ExposureRate(InputBreps=brep, InputPts=pt, Nomalized=Toggle(False), Radius=500, Segments=20)  # -> flatten(OutputLines), flatten(OutputExposureRates)
panel = Panel(u_sustain_er.OutputExposureRates)
bnd = Bounds(Numbers=u_sustain_er.OutputExposureRates)
remap = RemapNumbers(Value=u_sustain_er.OutputExposureRates, Source=bnd, Target=Domain(0, 1))  # -> Mapped, Clipped
gradient = Gradient(LowerLimit=0, UpperLimit=1, Parameter=remap.Mapped, stops=[0: RGB(0, 128, 0), 0.5: RGB(255, 255, 0), 1: RGB(255, 0, 0)])
preview = CustomPreview(Geometry=u_sustain_er.OutputLines, Material=gradient)
